# Grasshopper definition Sohcahtoa.ghx (Grasshopper 0.9.76)
# plug-ins: Sohcahtoa

adjacent = Slider(17.675, range=0..50)
angle = Slider(28.8, range=0..90)
rad = Radians(Degrees=angle)

tan = Tangent(Value=rad)
pt = ConstructPoint(XCoordinate=adjacent, YCoordinate=0, ZCoordinate=0)
multiplication = Multiplication(A=adjacent, B=tan)
pt_2 = ConstructPoint(XCoordinate=0, YCoordinate=0, ZCoordinate=0)
ln = Line(StartPoint=pt_2, EndPoint=pt)
pt_3 = ConstructPoint(XCoordinate=adjacent, YCoordinate=multiplication, ZCoordinate=0)
ln_2 = Line(StartPoint=pt, EndPoint=pt_3)
ln_3 = Line(StartPoint=pt_3, EndPoint=pt_2)
boundary = BoundarySurfaces(Edges=[ln, ln_2, ln_3])

ctri = ConstructTriangle(Adjacent=adjacent, Angle=rad)  # -> Opposite, Triangle
panel = Panel(multiplication)
panel_2 = Panel(ctri.Opposite)
